# Requirement set DevChallangeRequirments (R2023a)

## 1 [#1] If a simultanious input is detected, EDU fault is present or an Accelerator fault is present, the arbitrated pedal position must be 0

## 2 [#2] If no simultanious input is detected and no fault is present form the EDU or Accelerator pedal, the arbitrated pedal position must be equal to the accelerator pedal position

## 3 [#3] Effective Pedal Position AND Actual Pedal Position must always equal arbitrated accelerator position

## 4 [#4] 0 torque should be commended if the accelerator pedal is pressed AND the vehicle is in neutral.

## 5 [#5] 0 torque should be commended if the accelerator pedal is pressed AND the vehicle is in park.

## 6 [#6] When in drive, torque command must be positive

## 7 [#7] When In reverse, torque command must be negative

## 8 [#8] Disagreement fault must have a value of 1 if the accelerator pedal position primary and accelerator pedal position secondary differ

## 9 [#9] The primary out of range fault must have a value of 1 if the primary pedal position is outside the range 0-100

## 10 [#10] The secondary out of range fault must have a value of 1 if the secondary pedal position is outside the range 0-100

## 11 [#11] The Accelerator pedal fault must have a value of 1 if a disagreement fault, primary OOR or secondary OOR fault occur.